# Grasshopper definition 01_InteractiveContent.gh (Grasshopper 1.0.8)
# plug-ins: Vizor

# ----
# Server Connection
panel = Panel("ws://localhost:9090")
wsconnection = WsConnection(Address=panel, Reset=Button())  # -> WebsocketObject, ConnectionInfo
wsconnection_2 = Data(wsconnection.WebsocketObject)
connection_status = Panel(wsconnection.ConnectionInfo)

crv = Curve(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)
crv_2 = Curve(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)

# ----
# Define Marker
button = Button()
rec = Rectangle(crv)
rec_2 = Rectangle(crv_2)
tracked_object = TrackedObject(WebsocketObject=wsconnection_2, Disable=button, DeviceName="marker3")  # -> Output, TrackedDevice
tracked_object_2 = TrackedObject(WebsocketObject=wsconnection_2, Disable=Button(), DeviceName="marker2")  # -> Output, TrackedDevice
drec = DeconstructRectangle(Rectangle=rec_2)  # -> BasePlane, XInterval, YInterval
drec_2 = DeconstructRectangle(Rectangle=rec)  # -> BasePlane, XInterval, YInterval
marker1 = Data(tracked_object.TrackedDevice)
marker2 = Data(tracked_object_2.TrackedDevice)

# ----
# Define AR Client
button_2 = Button()
hololens = Hololens(WebsocketObject=wsconnection_2, Disable=button_2, DeviceName="HOLO1", SkillConfiguration="{\"robot-control\": 1}")  # -> Output, ARDevice

# ---- group: orient yourself with the marker
vec = VectorXYZ(XComponent=Slider(-0.19, range=-1..1), YComponent=Slider(0.76, range=-1..1), ZComponent=Slider(0, range=-1..1))  # -> Vector, Length

# ---- group: here is how you can control wireframe appearance
box = CenterBox(Base=PlaneXY(0, 0, 0), X=0.5, Y=0.1, Z=0.1)
Y = UnitY(Factor=-0.5)
move = Move(Geometry=box, Motion=Y)  # -> Geometry, Transform
move_2 = Move(Geometry=box, Motion=vec.Vector)  # -> Geometry, Transform
py3 = Python3Script(box=move_2.Geometry)  # -> out, a; inputs box: Box
# ---------- py3: Python ----------
"""Grasshopper Script"""
import Rhino.Geometry as rg

v = list(box.GetCorners())

p1 = [v[0], v[1], v[2], v[3], v[0]]
p2 = [v[4], v[5], v[6], v[7], v[4]]
p3 = [v[0], v[1], v[5], v[4], v[5]]
p4 = [v[6], v[2], v[3], v[7]]
a = p1+p2+p3+p4
# ---------- end py3 ----------

# ---- group: orient yourself with head-locked content
vec_2 = VectorXYZ(XComponent=Slider(0, range=-1..1), YComponent=Slider(1.59, range=0..2), ZComponent=Slider(-0.06, range=-1..1))  # -> Vector, Length

# ---- group: here is how you can change anchor in multi-marker setups
mesh = Mesh(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)
orient = Orient(Geometry=mesh, Source=PlaneXY(0, 0, 0), Target=drec.BasePlane)  # -> Geometry, Transform
orient_2 = Orient(Geometry=mesh, Source=PlaneXY(0, 0, 0), Target=drec_2.BasePlane)  # -> Geometry, Transform

# ---- group: here is how you make head-locked text
panel_2 = Panel("A little message for the user...")
xy = XYPlane(Origin=Point(0, 0, 0))
move_3 = Move(Geometry=xy, Motion=vec_2.Vector)  # -> Geometry, Transform

# ----
# Mesh
panel_3 = Panel("Person")
scene_mesh_object = SceneMeshObject(
    TargetAnchor=marker1,
    Meshes=orient.Geometry,
    Names=panel_3,
    Colours=ColourSwatch(SwatchColor=RGB(23, 0, 212)),
    DisplayRules="session")  # -> Output, MeshGeometryObjects
scene_mesh_object_2 = SceneMeshObject(
    TargetAnchor=marker2,
    Meshes=orient_2.Geometry,
    Names=panel_3,
    Colours=ColourSwatch(SwatchColor=RGB(212, 40, 189)),
    DisplayRules="session")  # -> Output, MeshGeometryObjects

# ----
# Wireframe
swatch = ColourSwatch(SwatchColor=RGB(41, 156, 212))
scene_wireframe_object = SceneWireframeObject(TargetAnchor=marker1, Breps=move.Geometry, Names="Wire", Colors=swatch, Widths=5, DisplayRules="session")  # -> Output, WireframeObjects
scene_wireframe_object_2 = SceneWireframeObject(
    TargetAnchor=marker1,
    Breps=move_2.Geometry,
    Names="Wire",
    Colors=ColourSwatch(SwatchColor=RGB(212, 40, 189)),
    Widths=5,
    DisplayRules="session",
    OptionalPointInput=py3.a)  # -> Output, WireframeObjects

# ----
# Text
swatch_2 = ColourSwatch(SwatchColor=RGB(121, 219, 112))
scene_text_object = SceneTextObject(
    TargetAnchor=hololens.ARDevice,
    Texts=panel_2,
    Planes=move_3.Geometry,
    Names="text",
    Colours=ColourSwatch(SwatchColor=RGB(212, 40, 189)),
    DisplayRules="session")  # -> Output, TextObjects
scene_text_object_2 = SceneTextObject(TargetAnchor=marker1, Texts=panel_2, Planes=PlaneXY(0, 0, 0), Names="text", Colours=swatch_2, DisplayRules="session")  # -> Output, TextObjects

# ----
# Create AR Content Object
panel_4 = Panel("composite-2")
construct_scene_content = ConstructSceneContent(
    Name="composite-1",
    Meshes=scene_mesh_object.MeshGeometryObjects,
    Wireframes=scene_wireframe_object.WireframeObjects,
    Texts=scene_text_object_2.TextObjects,
    LevelOfDetail=0)
construct_scene_content_2 = ConstructSceneContent(
    Name=panel_4,
    Meshes=scene_mesh_object_2.MeshGeometryObjects,
    Wireframes=scene_wireframe_object_2.WireframeObjects,
    Texts=scene_text_object.TextObjects,
    LevelOfDetail=0)
ar_content = Data(flatten([construct_scene_content, construct_scene_content_2]))

device_holo1 = Data(hololens.ARDevice)

# ----
# Triggered Display
device_holo1_2 = Data(device_holo1)
wsconnection_3 = Data(wsconnection_2)

# ----
# Static Display
update = BooleanToggle(False)
remove = BooleanToggle(False)
scene_model = XRSceneModel(
    GHControl=True,
    ARDevices=device_holo1,
    ContentObjects=flatten(ar_content),
    TriggerSend=update,
    TriggerRemove=remove,
    TimeDelay=100)
panel_5 = Panel(scene_model)

# ----
# Manual Trigger
list = ValueList({"composite-1", "composite-2"}, selected="composite-2")
publish = BooleanToggle(False)
publish_topic = PublishTopic(WSC=wsconnection_3, TopicName="signal/ur10", MessageType="std_msgs/String", Message=list, Publish=publish)

# ----
# Display content setup
update_2 = BooleanToggle(True)
scene_dynamic = SceneDynamic(Active=update_2, ARDevices=device_holo1_2, InputName="ur10", ContentObjects=flatten(ar_content))

panel_6 = Panel(scene_dynamic)
panel_7 = Panel(publish_topic)
