# Grasshopper definition 02_MultiActorTask.gh (Grasshopper 1.0.8)
# plug-ins: Vizor

# ----
# Server Connection
panel = Panel("ws://localhost:9090")
wsconnection = WsConnection(Address=panel, Reset=Button())  # -> WebsocketObject, ConnectionInfo

# ----
# Configure Skills
skills = Panel("{\"pick\": 1, \"pick-heavy\": 1}")
skills_2 = Panel("{\"pick\": 1, \"pick-heavy\": 0}")

brick_widths = Panel("""0.05
0.1
0.15""")
spiral_outer_radius = Slider(1.2, range=0..20)
number_of_rows = Slider(2, range=1..15)
relative_brick_spacing = Slider(1.2, range=1..2)
spiral_turns = Slider(1.1, range=0..10)
spiral_inner_radius = Slider(0.3, range=0..10)
brick_height = Slider(0.1, range=0..1)
brick_length = Slider(0.4, range=0..10)

websocket_connection = Data(wsconnection.WebsocketObject)

# ----
# Task Geometries
xy_plane = XYPlane(Origin=Point(0, 0, 0))
multiplication = Multiplication(A=brick_length, B=relative_brick_spacing)
absolute_spacing = Number(multiplication)
stacked_spiral_bricks = StackedSpiralBricks(
    plane=xy_plane,
    turns=spiral_turns,
    r0=spiral_inner_radius,
    r1=spiral_outer_radius,
    rows=number_of_rows,
    brick_spacing=absolute_spacing,
    brick_height=brick_height,
    brick_length=brick_length,
    brick_widths=brick_widths)  # -> bricks, brick_widths_4
box = Box(stacked_spiral_bricks.bricks)
number = Number(stacked_spiral_bricks.brick_widths_4)

# ----
# Define AR Clients
disable = BooleanToggle(False)
disable_2 = BooleanToggle(False)
hololens = Hololens(WebsocketObject=websocket_connection, Disable=disable, DeviceName="HOLO3", SkillConfiguration=skills_2)  # -> Output, ARDevice

# ----
# Define Marker
panel_2 = Panel("marker2")
tracked_object = TrackedObject(WebsocketObject=wsconnection.WebsocketObject, Disable=Button(), DeviceName=panel_2)  # -> Output, TrackedDevice

hololens_2 = Hololens(WebsocketObject=websocket_connection, Disable=Button(), DeviceName="HOLO1", SkillConfiguration=skills)  # -> Output, ARDevice
hololens_3 = Hololens(WebsocketObject=websocket_connection, Disable=disable_2, DeviceName="HOLO2", SkillConfiguration=skills_2)  # -> Output, ARDevice

# ----
# Geometry-Skill mapping
number_2 = Number(number)
skills_3 = Panel("pick")
skills_4 = Panel("pick,pick-heavy")
larger = LargerThan(FirstNumber=number_2, SecondNumber=Slider(0.12, range=0..1))  # -> LargerThan, OrEqualTo
pick_n_choose = PickNChoose(
    Pattern=graft(larger.OrEqualTo),
    Stream0=ColourSwatch(SwatchColor=RGB(103, 224, 63)),
    Stream1=ColourSwatch(SwatchColor=RGB(242, 136, 146)))  # -> flatten(Result)
pick_n_choose_2 = PickNChoose(Pattern=graft(larger.OrEqualTo), Stream0=skills_3, Stream1=skills_4)  # -> flatten(Result)
colour = Colour(pick_n_choose)
data = Data(pick_n_choose_2)

box_2 = Box(box)
colour_2 = Colour(colour)
mesh = Mesh(box)
list = ValueList({"session", "step", "persistent", "flange"}, selected="session")
list_2 = ValueList({"session", "step", "persistent", "flange"}, selected="step")

scene_mesh_object = SceneMeshObject(TargetAnchor=tracked_object.TrackedDevice, Meshes=mesh, Names="Brick", Colours=colour_2, DisplayRules=list_2)  # -> Output, graft(MeshGeometryObjects)
scene_wireframe_object = SceneWireframeObject(
    TargetAnchor=tracked_object.TrackedDevice,
    Breps=box_2,
    Names="wireframe",
    Colors=ColourSwatch(SwatchColor=RGB(41, 156, 212)),
    Widths=5,
    DisplayRules=list)  # -> Output, graft(WireframeObjects)

# ---- group: changed share task size
shared = BooleanToggle(False)
team_size = Panel("2")

# ----
# Create Content Object
panel_3 = Panel("Element 1")
construct_scene_content = ConstructSceneContent(
    Name=panel_3,
    Meshes=scene_mesh_object.MeshGeometryObjects,
    Wireframes=scene_wireframe_object.WireframeObjects,
    LevelOfDetail=0)  # -> flatten(ContentObject)
scene_content = Data(construct_scene_content)

text = Text(wsconnection.ConnectionInfo)
websocket_conenction_status = Panel(text)

# ----
# Simulation
button = Button()
acknowledge = Acknowledge(
    ARDevice=hololens_2.ARDevice,
    TriggerAcknowledge=button,
    TriggerReject=False,
    TriggerPing=False,
    TriggerHelp=False,
    TaskID=0)
acknowledge_2 = Acknowledge(
    ARDevice=hololens_3.ARDevice,
    TriggerAcknowledge=Button(),
    TriggerReject=False,
    TriggerPing=False,
    TriggerHelp=False,
    TaskID=0)
acknowledge_3 = Acknowledge(
    ARDevice=hololens.ARDevice,
    TriggerAcknowledge=Button(),
    TriggerReject=False,
    TriggerPing=False,
    TriggerHelp=False,
    TaskID=0)

# ----
# Configure Teams
lng = ListLength(List=scene_content)

# ---- group: change sequential/parallel
value_list = ValueList({"All same": 0, "Alternating Series & Parallel": 1}, selected="All same")
panel_4 = Panel("""0
1
1""")
parallel = BooleanToggle(False)
dup = DuplicateData(Data=panel_4, Number=lng, Order=True)
stream_filter = StreamFilter(Gate=value_list, Stream0=parallel, Stream1=dup)

# ----
make_task_series = MakeTaskSeries(TaskName="Task Name", TaskCount=lng, StartFrom=0, ParallelMode=stream_filter, SharedMode=shared, TeamSize=team_size)
data_2 = Data(make_task_series)

# ---- group: you can indicate a desired target, but worker pool will match based on skill + availability
# Task assignment
value_list_2 = ValueList({"Assign all to HOLO1": 0, "Taking turns between HOLO's": 1}, selected="Taking turns between HOLO's")
lng_2 = ListLength(List=scene_content)
sequence = Panel("""0
1
2""")
panel_5 = Panel("0")
repeat_data = RepeatData(Data=sequence, Length=lng_2)

# ----
repeat_data_2 = RepeatData(Data=panel_5, Length=lng_2)

# ---- group: you can indicate a desired target, but worker pool will match based on skill + availability (continued)
stream_filter_2 = StreamFilter(Gate=value_list_2, Stream0=repeat_data_2, Stream1=repeat_data)
data_3 = Data(stream_filter_2)

# ----
# Create Tasks
instructions = Panel("Place the brick in the highlighted area. ")
weave = Weave(
    Pattern=graft(data_3),
    Stream0=hololens_2.ARDevice,
    Stream1=hololens_3.ARDevice,
    Stream2=hololens.ARDevice,
    NullGaps=False)  # -> flatten(Weave)
construct_task_object = ConstructTaskObject(
    TaskNames=data_2,
    TargetDevices=weave,
    SceneContents=scene_content,
    InstructionTexts=instructions,
    AssociatedSkill=data,
    EstimatedDuration=60)  # -> Output, TaskObject
tasks = Data(construct_task_object.TaskObject)

# ----
# Send to HoloLens
reset = Button()
task_controller = TaskController(Start=invert(reset), HRCTasks=tasks, GHControl=True)  # -> CurrentTask, ProcessLog
panel_6 = Panel(task_controller.ProcessLog)

# ----
# Currently active task
deconstruct_task_object = DeconstructTaskObject(TaskObjects=task_controller.CurrentTask)  # -> TaskID, TaskName, TargetDeviceName, SceneMeshes, SceneTexts, SceneWires, InstructionText, RobotTrajectoryFrames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
panel_7 = Panel(deconstruct_task_object.TargetDeviceName)
mesh_2 = Mesh(deconstruct_task_object.SceneMeshes)
geometry = Geometry(deconstruct_task_object.SceneTexts)
geometry_2 = Geometry(deconstruct_task_object.SceneWires)

# ==== cluster StackedSpiralBricks

# ---- group: Spiral
plane = ClusterInput()
turns = ClusterInput()
r0 = ClusterInput()
r1 = ClusterInput()

# ----
rows = ClusterInput()
brick_height = ClusterInput()
brick_length = ClusterInput()
brick_widths = ClusterInput()
brick_spacing = ClusterInput()
brick_spacing_2 = Number(brick_spacing)
brick_widths_2 = Number(brick_widths)
brick_height_2 = Number(brick_height)
brick_length_2 = Number(brick_length)

# ---- group: Brick spacing
number = Number(brick_spacing_2)

# ---- group: Brick height
number_2 = Number(brick_height_2)

# ---- group: Number of rows
number_3 = Number(rows)

# ---- group: Brick spacing
number_4 = Number(expr("x*-.5", number))

# ----
# Create base curves
panel = Panel("0")
create_spiral = Python3Script(plane=plane, pitch=panel, turns=turns, r0=r0, r1=r1)  # -> out, spiral; inputs plane: Plane, pitch: Double, turns: Double, r0: Double, r1: Double
# ---------- create_spiral: Python ----------
import Rhino.Geometry as rg

spiral = rg.NurbsCurve.CreateSpiral(plane.Origin, plane.ZAxis, plane.YAxis, pitch, turns, r0, r1)
# ---------- end create_spiral ----------
series = Series(Start=0, Step=number_2, Count=number_3)
unit_z = UnitZ(Factor=series)
move = Move(Geometry=create_spiral.spiral, Motion=unit_z)  # -> graft(Geometry), Transform
series_2 = Series(Start=0, Step=number_4, Count=number_3)
extend_curve = ExtendCurve(Curve=move.Geometry, Type=0, Start=graft(series_2), End=graft(series_2))
curve = Curve(extend_curve)

# ---- group: Subdivionsion length
number_5 = Number(brick_spacing_2)

# ----
# Create stacked boxes
brick_length_3 = Number(brick_length_2)
brick_widths_3 = Number(brick_widths_2)
brick_height_3 = Number(brick_height_2)
curve_2 = Curve(curve)
divide_length = DivideLength(Curve=curve_2, Length=number_5)  # -> Points, Tangents, Parameters
evaluate_curve = EvaluateCurve(Curve=curve_2, Parameter=divide_length.Parameters)  # -> Point, Tangent, Angle
xy_plane = XYPlane(Origin=evaluate_curve.Point)
align_plane = AlignPlane(Plane=xy_plane, Direction=evaluate_curve.Tangent)  # -> Plane, Angle
plane_2 = Plane(align_plane.Plane)

# ---- group: Brick widths
number_6 = Number(brick_widths_3)

# ----
# Width
list_length = ListLength(List=evaluate_curve.Tangent)
repeat_data = RepeatData(Data=number_6, Length=list_length)
number_7 = Number(repeat_data)
construct_domain = ConstructDomain(DomainStart=expr("x*-0.5", number_7), DomainEnd=expr("x*0.5", number_7))

# ---- group: Brick length
number_8 = Number(brick_length_3)

# ----
# Length
construct_domain_2 = ConstructDomain(DomainStart=expr("x*-0.5", number_8), DomainEnd=expr("x*0.5", number_8))

# ---- group: Brick height
number_9 = Number(brick_height_3)

# ----
rectangle = Rectangle(Plane=plane_2, XSize=construct_domain_2, YSize=construct_domain, Radius=0)  # -> Rectangle, Length
box_rectangle = BoxRectangle(Rectangle=rectangle.Rectangle, Height=number_9)
box = Box(flatten(box_rectangle))
number_10 = Number(flatten(number_7))

bricks = ClusterOutput(box)
brick_widths_4 = ClusterOutput(number_10)
