# Grasshopper definition 03_HumanRobotCollaboration.gh (Grasshopper 1.0.8)
# plug-ins: VirtualRobot.Grasshopper, Vizor

panel = Panel("ws://172.24.60.156:9090")

# ----
# Server Connection
panel_2 = Panel("ws://localhost:9090/")
wsconnection = WsConnection(Address=panel_2, Reset=Button())  # -> WebsocketObject, ConnectionInfo

# ---- group: gripping point
xy = XYPlane(Origin=Point(0, 0, 0))
Z = UnitZ(Factor="157.5")
move = Move(Geometry=xy, Motion=Z)  # -> Geometry, Transform

# ---- group: Open gripper
mesh = Mesh(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)

# ---- group: Closed gripper
mesh_2 = Mesh(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)

# ----
# Gripper
open_gripper = BooleanToggle(True)
filter = StreamFilter(Gate=open_gripper, Stream0=mesh, Stream1=mesh_2)
end_effector = DefineEndEffector(Geometry=filter, TCPFrame=move.Geometry, MountingFrame=PlaneXY(0, 0, 0))

# ----
# Scale with rhino unit
re_check = Button()
unit_scaling_factor = Python3Script(check=re_check)  # -> scaling_factor
# ---------- unit_scaling_factor: Python ----------
import scriptcontext as sc
import Rhino


print(sc.doc.ModelUnitSystem)
# required scaling in relation to mm
scaling_factor = 1/Rhino.RhinoMath.MetersPerUnit(sc.doc.ModelUnitSystem)/1000
print(scaling_factor)
# ---------- end unit_scaling_factor ----------
scaling_factor = Number(unit_scaling_factor)

# ----
# Axis toggles
toggle = BooleanToggle(False)
merge = Merge(Data1=toggle, Data2=Toggle(False), Data3=Toggle(True))

# ----
# Robot Definition
xy_2 = XYPlane(Origin=Point(0, 0, 0))
ur10 = PredefinedUniversalRobotUR10(BaseFrame=xy_2, EndEffectorOptional=end_effector)
links = Panel("""new_ur10_gripper
base_link
base_link_inertia
shoulder_link
upper_arm_link
forearm_link
wrist_1_link
wrist_2_link
wrist_3_link
flange""")
virtualrobot_robot_object = Data(ur10)
robot = Robot(
    WebsocketObject=wsconnection.WebsocketObject,
    Disable=Button(),
    RobotName="UR10",
    VirtualRobotModelNS=virtualrobot_robot_object,
    AxisToggles=merge,
    LinkNames=links)  # -> Output, RobotObject
vizor_robot_object = Data(robot.RobotObject)

# ----
# AR Worker Definition
button = Button()
hololens = Hololens(
    WebsocketObject=wsconnection.WebsocketObject,
    Disable=button,
    DeviceName="HOLO1",
    SkillConfiguration="{\"robot-control\": 1}")  # -> Output, ARDevice

# ---- group: placement
brep = Brep([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])
point = Point([Point(2.35439321, 904.5727979, 90), Point(64.91764402, 884.5727979, 192.5), Point(-57.0452816, 884.5727979, 192.5), Point(2.416958261, 904.5727979, 335)])

# ---- group: pickup
geo = Geometry([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])
point_2 = Point([Point(153.8061716, 539.0881367, 90), Point(53.80617157, 539.0881367, 90), Point(-46.19382843, 539.0881367, 90), Point(-146.1938284, 539.0881367, 90)])

# ---- group: safety position
home_position = Point(Point(-0.4928767003, 553.8078973, 484.762151))
xy_3 = XYPlane(Origin=home_position)
pflip = FlipPlane(Plane=xy_3, ReverseX=False, ReverseY=False, SwapAxes=True)
cluster = Cluster_3(geo=pflip, scaling_factor=scaling_factor)

# ---- group: pick and place approach offset
offset_mm = Panel("80")
multiplication = Multiplication(A=offset_mm, B=scaling_factor)

# ---- group: text-point
text_point = Point(Point(-56.78806433, 1157.703648, 377.1830372))

# ---- group: table
table = Brep([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])

# ----
# Auxilary Scene Geometries
gripper = Mesh(filter)
cluster_2 = Cluster_3(geo=table, scaling_factor=scaling_factor)
cluster_3 = Cluster_3(geo=gripper, scaling_factor=scaling_factor)
yz = YZPlane(Origin=Point(0, 0, 0))
pflip_2 = FlipPlane(Plane=yz, ReverseX=False, ReverseY=False, SwapAxes=True)
rotate = Rotate(Geometry=cluster_3, Angle=1.570796327, Plane=PlaneXY(0, 0, 0))  # -> Geometry, Transform
scene_wireframe_object = SceneWireframeObject(
    TargetAnchor=vizor_robot_object,
    Breps=cluster_2,
    Names="wireframe",
    Colors=ColourSwatch(SwatchColor=RGB(70, 143, 207)),
    Widths=5,
    DisplayRules="session")  # -> Output, WireframeObjects
list = ValueList({"session", "step", "persistent", "flange"}, selected="flange")
rotate_2 = Rotate(Geometry=rotate.Geometry, Angle=1.570796327, Plane=pflip_2)  # -> Geometry, Transform
scene_mesh_object = SceneMeshObject(
    TargetAnchor=vizor_robot_object,
    Meshes=rotate_2.Geometry,
    Names="mesh",
    Colours=ColourSwatch(SwatchColor=RGB(122, 122, 122)),
    DisplayRules=list)  # -> Output, MeshGeometryObjects
construct_scene_content = ConstructSceneContent(
    Name="content object",
    Meshes=scene_mesh_object.MeshGeometryObjects,
    Wireframes=scene_wireframe_object.WireframeObjects,
    LevelOfDetail=0)
xr_scene_model = XRSceneModel(
    GHControl=True,
    ARDevices=hololens.ARDevice,
    ContentObjects=construct_scene_content,
    TriggerSend=Toggle(True),
    TriggerRemove=False,
    TimeDelay=100)

scaling_factor_2 = Number(scaling_factor)

# ----
# Simulation
# HOLO1
button_2 = Button()
simulate = SimulateDevice(
    NetworkDevice=hololens.ARDevice,
    TriggerAcknowledge=button_2,
    TriggerReject=False,
    TriggerPing=False,
    TriggerHelp=False,
    TaskID=0)

# ----
# Task Geometries
scaling_factor_3 = Number(scaling_factor)

# ----
# Unit scaling
cluster_4 = Cluster_3(geo=brep, scaling_factor=scaling_factor_3)
cluster_5 = Cluster_3(geo=point, scaling_factor=scaling_factor_3)
cluster_6 = Cluster_3(geo=geo, scaling_factor=scaling_factor_3)
cluster_7 = Cluster_3(geo=point_2, scaling_factor=scaling_factor_3)

brep_2 = Brep(cluster_4)
point_3 = Point(cluster_5)
brep_3 = Brep(cluster_6)
point_4 = Point(cluster_7)

# ----
# Human Tasks
swatch = ColourSwatch(SwatchColor=RGB(8, 255, 218))
list_2 = ValueList({"session", "step", "persistent", "flange"}, selected="session")
mesh_3 = Mesh(brep_2)
scene_mesh_object_2 = SceneMeshObject(TargetAnchor=vizor_robot_object, Meshes=mesh_3, Names="mesh", Colours=swatch, DisplayRules=list_2)  # -> Output, graft(MeshGeometryObjects)
lng = ListLength(List=flatten(mesh_3))
construct_scene_content_2 = ConstructSceneContent(Name="content object", Meshes=scene_mesh_object_2.MeshGeometryObjects, LevelOfDetail=0)  # -> flatten(ContentObject)
make_task_series = MakeTaskSeries(TaskName="Sample Task", TaskCount=lng, StartFrom=0, ParallelMode=False, SharedMode=False, TeamSize=2)
construct_task_object = ConstructTaskObject(
    TaskNames=make_task_series,
    TargetDevices=hololens.ARDevice,
    SceneContents=construct_scene_content_2,
    InstructionTexts="Your turn to place the beam.",
    AssociatedSkill="null",
    EstimatedDuration=60)  # -> Output, TaskObject

# ----
# Robot Task Creation
robot_trajectory = RobotTrajectory(brep=brep_3, pickup_point=point_4, pln=cluster, approach_offset=multiplication, brep_2=brep_2, placement_point=point_3)  # -> F, F_2, F_3, plane_5
robot_2 = Data(vizor_robot_object)
panel_3 = Panel("""_pickup
_place
_home""")

# ----
# Creation of auxilary visualizations for worker
lng_2 = ListLength(List=flatten(robot_trajectory.plane_5))
yz_2 = YZPlane(Origin=text_point)
series = Series(Start=0, Step=1, Count=lng_2)
rotate_3 = Rotate(Geometry=yz_2, Angle=-1.570796327, Plane=yz_2)  # -> Geometry, Transform
cluster_8 = Cluster(T=robot_2, A=robot_trajectory.plane_5, M=brep_3, G=brep_2)  # -> graft(M_3), graft(M_2)
concat = Concatenate(FragmentD="pick", FragmentA=series)  # -> graft(Result)
concat_2 = Concatenate(FragmentD="place", FragmentA=series)  # -> graft(Result)
text = SceneTextObject(
    TargetAnchor=robot_2,
    Texts="Placement complete. ",
    Planes=rotate_3.Geometry,
    Names="text",
    Colours=RGB(237, 195, 9),
    DisplayRules="session")  # -> Output, TextObjects
content = ConstructSceneContent(Name=concat, Meshes=cluster_8.M_3, LevelOfDetail=0)
content_2 = ConstructSceneContent(Name=concat_2, Meshes=cluster_8.M_2, LevelOfDetail=0)
content_3 = ConstructSceneContent(Name="content object", Texts=text.TextObjects, LevelOfDetail=0)
dup = DuplicateData(Data=content_3, Number=lng_2, Order=True)  # -> graft(Data)
merge_2 = Merge(Data1=simplify(content), Data2=simplify(content_2), Data3=simplify(dup))  # -> flatten(Result)

# ----
# Virtual Robot Debugging
virtualrobot_robot_object_2 = Data(virtualrobot_robot_object)
scaling_factor_4 = Number(scaling_factor)
plane = Plane(robot_trajectory.F)
plane_2 = Plane(robot_trajectory.F_2)
plane_3 = Plane(robot_trajectory.F_3)
merge_3 = Merge(Data1=plane, Data2=plane_2, Data3=plane_3)
display_scaler = DisplayScaler(geo=merge_3, scaling_factor=scaling_factor_4)  # -> flatten(G)
iframe = InterpolateFrames(Frames=display_scaler, Length=Slider(0.999, range=0..0.999), Step="0.1", Reset=Toggle(True))  # -> Frame, Percent, CurrentIndex
robot_ik = RobotInverseKinematics(Robot=virtualrobot_robot_object_2, TargetTCPFrame=iframe.Frame, AxisToggles=[False, False, False], useColorPreview=True)  # -> PoseGeometry, AxisValues, AxisFrames

# ----
# Robot task creation
number_slider = Slider(2.7, range=0..10)
cartesian = BooleanToggle(True)
robot_trajectory_object = RobotTrajectoryObject(TargetRobot=robot_2, ParamSpace=cartesian, TCPFrames=robot_trajectory.F_2, TrajectoryWidth=number_slider)  # -> Output, TrajectoryObject, TrajectoryMesh
robot_trajectory_object_2 = RobotTrajectoryObject(TargetRobot=robot_2, ParamSpace=cartesian, TCPFrames=robot_trajectory.F, TrajectoryWidth=number_slider)  # -> Output, TrajectoryObject, TrajectoryMesh
robot_trajectory_object_3 = RobotTrajectoryObject(TargetRobot=robot_2, ParamSpace=cartesian, TCPFrames=robot_trajectory.F_3, TrajectoryWidth=number_slider)  # -> Output, TrajectoryObject, TrajectoryMesh
merge_4 = Merge(
    Data1=simplify(robot_trajectory_object_2.TrajectoryObject),
    Data2=simplify(robot_trajectory_object.TrajectoryObject),
    Data3=simplify(robot_trajectory_object_3.TrajectoryObject))  # -> flatten(Result)

concat_3 = Concatenate(FragmentA=graft(series), FragmentB=panel_3)  # -> flatten(Result)
task = ConstructTaskObject(
    TaskNames=flatten(concat_3),
    TargetDevices=robot_2,
    SceneContents=flatten(merge_2),
    RobotTrajectory=flatten(merge_4),
    AssociatedSkill="null",
    EstimatedDuration=60)  # -> Output, TaskObject

# ----
# Define task assignment
all_human = Panel("""H
H
H
H""")
robotic = Panel("""R
R
R
R""")
collaborative = Panel("""R
H
H
R""")
scaling_factor_5 = Number(scaling_factor)
value_list = ValueList({"All robot": 0, "Collaboration": 1, "All human": 2² - 2}, selected="Collaboration")
human_tasks = Data(construct_task_object.TaskObject)
robot_tasks = Data(task.TaskObject)
stream_filter = StreamFilter(Gate=value_list, Stream0=robotic, Stream1=collaborative, Stream2=all_human)
py3 = Python3Script(pattern=stream_filter, human=human_tasks, robot=robot_tasks)  # -> out, tasks; inputs pattern: list, human: list, robot: list
# ---------- py3: Python ----------
tasks = []

for i in range(len(pattern)):
    
    actor = pattern[i]
    
    if actor == 'H':
        tasks += human[i : i+1]
    elif actor == "R":
        tasks += robot[i*3 : i*3+3]
# ---------- end py3 ----------

# ---- group: bonus task for fun :)
cluster_9 = Cluster_4(data=robot_2, scaling_factor=scaling_factor_5, devices=hololens.ARDevice, point=text_point)

# ----
merge_5 = Merge(Data1=flatten(py3.tasks), Data2=flatten(cluster_9))

# ----
# Run process
button_3 = Button()
task_list = Data(merge_5)
not = GateNot(A=button_3)
task_controller = TaskController(Start=not, HRCTasks=task_list, GHControl=True)  # -> CurrentTask, ProcessLog
panel_4 = Panel(task_controller.ProcessLog)
current_task = Data(task_controller.CurrentTask)
deconstruct_task_object = DeconstructTaskObject(TaskObjects=current_task)  # -> TaskID, TaskName, TargetDeviceName, SceneMeshes, SceneTexts, SceneWires, InstructionText, RobotTrajectoryFrames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
mesh_4 = Mesh(deconstruct_task_object.SceneMeshes)
panel_5 = Panel(deconstruct_task_object.InstructionText)

# ---- group: Simulated Robot Execution / change input to manual to simulate individual robot task
list_3 = ValueList({"Live": 0, "Manual": 1}, selected="Live")
item = ListItem(List=task.TaskObject, Index=Slider(0, range=0..11), Wrap=False)
filter_2 = StreamFilter(Gate=list_3, Stream0=current_task, Stream1=item)

# ----
# Robot
button_4 = Button()
simulate_2 = SimulateDevice(
    NetworkDevice=vizor_robot_object,
    TriggerSuccess=button_4,
    TriggerError=Button(),
    TriggerPause=False,
    TriggerStop=False,
    TaskID=deconstruct_task_object.TaskID)

# ---- group: Simulated Robot Execution
# Simulated robot execution
number_slider_2 = Slider(150, range=100..1500)
simulator = RobotSimulator(Robot=vizor_robot_object, RobotTask=filter_2, StepInterval=number_slider_2, Start=Toggle(True))  # -> Output, CurrentTCP, CurrentGeometry, ExternalAxis
display_scaler_2 = DisplayScaler(geo=simulator.CurrentTCP, scaling_factor=scaling_factor_2)  # -> flatten(G)
robot_ik_2 = RobotInverseKinematics(Robot=ur10, TargetTCPFrame=display_scaler_2, AxisToggles=[False, False, False], useColorPreview=True)  # -> PoseGeometry, AxisValues, AxisFrames

# ---- group: Physical Robot Execution - requires MAIL
update = Button()  # disabled
toggle_2 = BooleanToggle(True)  # disabled
executor = RobotExecution(Robot=vizor_robot_object, RobotTask=current_task, Start=update, Physical=toggle_2)  # disabled

# ----
polyline = PolyLine(Vertices=deconstruct_task_object.RobotTrajectoryFrames, Closed=False)
display_scaler_3 = DisplayScaler(geo=[mesh_4, polyline], scaling_factor=scaling_factor_2)  # -> flatten(G)

# ==== cluster RobotTrajectory
brep = ClusterInput()
pickup_point = ClusterInput()
pln = ClusterInput()

# ---- group: approach offset
approach_offset = ClusterInput()  # Distance in Z where the robot goes straight down
number = Number(approach_offset)

# ----
brep_2 = ClusterInput()
placement_point = ClusterInput()

# ---- group: pickup
brep_3 = Brep(brep)
point = Point(pickup_point)

# ---- group: placement
brep_4 = Brep(brep_2)
point_2 = Point(placement_point)

# ---- group: waypoint
pln_2 = Plane(pln)

# ---- group: placement
point_3 = Point(point_2)
brep_5 = Brep(brep_4)

# ---- group: pickup
point_4 = Point(point)
brep_6 = Brep(brep_3)

# ----
# Get long edge
edges_from_faces = EdgesFromFaces(Brep=brep_5, Points=point_3)  # -> Edges, Indices
length = Length(Curve=edges_from_faces.Edges)
sort_list = SortList(Keys=length, ValuesValuesA=edges_from_faces.Edges)  # -> Keys, ValuesValuesA
list_item = ListItem(List=sort_list.ValuesValuesA, Index="-1", Wrap=True)
long_edge = Curve(flatten(list_item))

# ----
# Get long edge
edges_from_faces_2 = EdgesFromFaces(Brep=brep_6, Points=point_4)  # -> Edges, Indices
length_2 = Length(Curve=edges_from_faces_2.Edges)
sort_list_2 = SortList(Keys=length_2, ValuesValuesA=edges_from_faces_2.Edges)  # -> Keys, ValuesValuesA
list_item_2 = ListItem(List=sort_list_2.ValuesValuesA, Index="-1", Wrap=True)
long_edge_2 = Curve(flatten(list_item_2))

# ----
# Origin + Normal
brep_closest_point = BrepClosestPoint(Point=point_3, Brep=brep_5)  # -> Point, Normal, Distance
reverse = Reverse(Vector=brep_closest_point.Normal)
point_5 = Point(brep_closest_point.Point)
vector = Vector(reverse)

# ----
# Origin + Normal
brep_closest_point_2 = BrepClosestPoint(Point=point_4, Brep=brep_6)  # -> Point, Normal, Distance
reverse_2 = Reverse(Vector=brep_closest_point_2.Normal)
point_6 = Point(brep_closest_point_2.Point)
vector_2 = Vector(reverse_2)

# ----
# Long edge tangent
long_edge_3 = Curve(long_edge)
curve_closest_point = CurveClosestPoint(Point=point_3, Curve=long_edge_3)  # -> Point, Parameter, Distance
evaluate_curve = EvaluateCurve(Curve=long_edge_3, Parameter=curve_closest_point.Parameter)  # -> Point, Tangent, Angle
vector_3 = Vector(evaluate_curve.Tangent)

# ----
# Long edge tangent
long_edge_4 = Curve(long_edge_2)
curve_closest_point_2 = CurveClosestPoint(Point=point_4, Curve=long_edge_4)  # -> Point, Parameter, Distance
evaluate_curve_2 = EvaluateCurve(Curve=long_edge_4, Parameter=curve_closest_point_2.Parameter)  # -> Point, Tangent, Angle
vector_4 = Vector(evaluate_curve_2.Tangent)

# ----
# Placement planes
plane_normal_yup = Python3Script(Origin=point_5, Normal=vector, Y_direction=vector_3)  # -> out, Plane; inputs Origin: Point3d, Normal: Vector3d, Y_direction: Vector3d
# ---------- plane_normal_yup: Python ----------
"""Grasshopper Script"""
a = "Hello Python 3 in Grasshopper!"
print(a)

import Rhino.Geometry as rg

Plane = rg.Plane.CreateFromNormalYup(Origin, Normal, Y_direction)
# ---------- end plane_normal_yup ----------

# ----
# Pickup planes
plane_normal_yup_2 = Python3Script(Origin=point_6, Normal=vector_2, Y_direction=vector_4)  # -> out, Plane; inputs Origin: Point3d, Normal: Vector3d, Y_direction: Vector3d; same code as plane_normal_yup
plane = Plane(graft(plane_normal_yup_2.Plane))

# ---- group: Placement plane
plane_2 = Plane(graft(plane_normal_yup.Plane))

# ---- group: pickup point / Pick-up plane
plane_3 = Plane(plane)

# ---- group: approach offset
number_2 = Number(number)

# ---- group: Placement plane
plane_4 = Plane(plane_2)

# ----
Z = UnitZ(Factor=number_2)

number_slider = Slider(15, range=0..100)
expression = Expression(x=number_slider, Expression="1/(x-1)-0.001")
number_slider_2 = Slider(0.01, range=0..0.1)
series = Series(Start=0, Step=expression, Count=number_slider)
toggle = BooleanToggle(True)
num = Number(series)

lng = ListLength(List=flatten(plane_4))
dup = DuplicateData(Data=pln_2, Number=lng, Order=True)  # -> simplify(graft(Data))
dup_2 = DuplicateData(Data=pln_2, Number=lng, Order=True)  # -> simplify(graft(Data))
dup_3 = DuplicateData(Data=pln_2, Number=lng, Order=True)
move = Move(Geometry=plane_3, Motion=Z)  # -> Geometry, Transform
move_2 = Move(Geometry=plane_4, Motion=Z)  # -> Geometry, Transform
merge = Merge(Data1=simplify(graft(dup_3)), Data2=simplify(move.Geometry), Data3=simplify(plane_3))  # -> simplify(Result)
merge_2 = Merge(
    Data1=simplify(graft(plane_3)),
    Data2=simplify(graft(move.Geometry)),
    Data3=dup,
    Data4=simplify(move_2.Geometry),
    Data5=simplify(plane_4))
merge_3 = Merge(Data1=simplify(plane_4), Data2=simplify(move_2.Geometry), Data3=dup_2)
iframe = InterpolateFrames(Frames=merge, Length=num, Step=number_slider_2, Reset=toggle)  # -> Frame, Percent, CurrentIndex
iframe_2 = InterpolateFrames(Frames=merge_2, Length=num, Step=number_slider_2, Reset=toggle)  # -> Frame, Percent, CurrentIndex
iframe_3 = InterpolateFrames(Frames=merge_3, Length=num, Step=number_slider_2, Reset=toggle)  # -> Frame, Percent, CurrentIndex
F = ClusterOutput(iframe.Frame)
F_2 = ClusterOutput(iframe_2.Frame)
F_3 = ClusterOutput(iframe_3.Frame)
plane_5 = ClusterOutput(plane_2)

# ==== cluster Cluster
T = ClusterInput()
A = ClusterInput()
M = ClusterInput()
G = ClusterInput()

# ----
# Attach to flange in transit
number_slider = Slider(0, range=0..1000)
vec = VectorXYZ(XComponent=0, YComponent=number_slider, ZComponent="0")  # -> Vector, Length
xy = XYPlane(Origin=Point(0, 0, 0))
move = Move(Geometry=xy, Motion=vec.Vector)  # -> Geometry, Transform
orient = Orient(Geometry=G, Source=flatten(A), Target=move.Geometry)  # -> Geometry, Transform
list = ValueList({"session", "step", "persistent", "flange"}, selected="flange")
mesh = SceneMeshObject(
    TargetAnchor=T,
    Meshes=orient.Geometry,
    Names="ee-beam",
    Colours=ColourSwatch(SwatchColor=RGB(255, 117, 117)),
    DisplayRules=list)  # -> Output, MeshGeometryObjects
M_2 = ClusterOutput(mesh.MeshGeometryObjects)

panel = Panel("-15")

# ----
# Pick position
swatch = ColourSwatch(SwatchColor=RGB(170, 240, 207))
list_2 = ValueList({"session", "step", "persistent", "flange"}, selected="step")
mesh_2 = SceneMeshObject(TargetAnchor=T, Meshes=M, Names="pick-beam", Colours=swatch, DisplayRules=list_2)  # -> Output, MeshGeometryObjects

# ----
# Place position
swatch_2 = ColourSwatch(SwatchColor=RGB(94, 219, 219))
list_3 = ValueList({"session", "step", "persistent", "flange"}, selected="session")
mesh_3 = SceneMeshObject(TargetAnchor=T, Meshes=G, Names="final-beam", Colours=swatch_2, DisplayRules=list_3)  # -> Output, MeshGeometryObjects

M_3 = ClusterOutput(mesh_2.MeshGeometryObjects)

# ==== cluster Cluster_4
data = ClusterInput()
scaling_factor = ClusterInput()
point = ClusterInput()
cluster = Cluster_2(O=point)
data_2 = Data(data)
cluster_2 = Cluster_3(geo=cluster, scaling_factor=scaling_factor)

# ---- group: table
brep = Brep(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)

# ---- group: smiley
brep_2 = Brep([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])

# ----
cluster_3 = Cluster_3(geo=brep, scaling_factor=scaling_factor)
cluster_4 = Cluster_3(geo=brep_2, scaling_factor=scaling_factor)
list = ValueList({"session", "step", "persistent", "flange"}, selected="step")
width = Panel("10")
list_2 = ValueList({"session", "step", "persistent", "flange"}, selected="step")
list_3 = ValueList({"session", "step", "persistent", "flange"}, selected="step")
wireframe = SceneWireframeObject(
    TargetAnchor=data_2,
    Breps=cluster_3,
    Names="wireframe",
    Colors=ColourSwatch(SwatchColor=RGB(92, 255, 138)),
    Widths=width,
    DisplayRules=list)  # -> Output, WireframeObjects
mesh = SceneMeshObject(
    TargetAnchor=data_2,
    Meshes=cluster_4,
    Names="mesh",
    Colours=ColourSwatch(SwatchColor=RGB(255, 242, 145)),
    DisplayRules=list_3)  # -> Output, MeshGeometryObjects
text = SceneTextObject(
    TargetAnchor=data_2,
    Texts="well done!",
    Planes=cluster_2,
    Names="text",
    Colours=ColourSwatch(SwatchColor=RGB(255, 92, 201)),
    DisplayRules=list_2)  # -> Output, TextObjects
content = ConstructSceneContent(
    Name="content object",
    Meshes=mesh.MeshGeometryObjects,
    Wireframes=wireframe.WireframeObjects,
    Texts=text.TextObjects,
    LevelOfDetail=0)
devices = ClusterInput()
# Bonus Task
task = ConstructTaskObject(
    TaskNames="Bonus Task",
    TargetDevices=devices,
    SceneContents=content,
    InstructionTexts="ta da!",
    AssociatedSkill="null",
    EstimatedDuration=60)  # -> Output, TaskObject
task_2 = ClusterOutput(task.TaskObject)

# ==== cluster DisplayScaler
scaling_factor = ClusterInput()
# Display + Sim scaler
geo = ClusterInput()
one_over_x = OneOverX(Value=scaling_factor)
geo_2 = Geometry(geo)
scale = Scale(Geometry=geo_2, Center=Point(0, 0, 0), Factor=one_over_x)  # -> Geometry, Transform
G = ClusterOutput(scale.Geometry)

# ==== cluster Cluster_2
O = ClusterInput()
yz = YZPlane(Origin=O)
rotate = Rotate(Geometry=yz, Angle=-1.570796327, Plane=yz)  # -> Geometry, Transform
G = ClusterOutput(rotate.Geometry)

# ==== cluster Cluster_3
scaling_factor = ClusterInput()
geo = ClusterInput()
# Unit scaler
geo_2 = Geometry(geo)
scale = Scale(Geometry=geo_2, Center=Point(0, 0, 0), Factor=scaling_factor)  # -> Geometry, Transform
G = ClusterOutput(scale.Geometry)
