# Grasshopper definition VirtualRobot_Intro.gh (Grasshopper 1.0.8)
# plug-ins: VirtualRobot.Grasshopper

# ----
# Adjust Tool Center Point for Gripper
panel = Panel("120")
Z = UnitZ(Factor=panel)
# Pick options
xy = XYPlane(Origin=Point(0, 0, 0))
move = Move(Geometry=xy, Motion=Z)  # -> Geometry, Transform
plane = Plane(move.Geometry)

# ---- group: Open Gripper
mesh = Mesh(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)

# ----
# Gripper
end_effector = DefineEndEffector(Geometry=mesh, TCPFrame=plane, MountingFrame=PlaneXY(0, 0, 0))

# ----
# Robot definition
use_gripper = BooleanToggle(True)
construct_point = ConstructPoint(XCoordinate=0, YCoordinate=0, ZCoordinate=0)
stream_filter = StreamFilter(Gate=use_gripper, Stream1=end_effector)
xy_plane = XYPlane(Origin=construct_point)
predefined_universal_robot_ur10 = PredefinedUniversalRobotUR10(BaseFrame=xy_plane, EndEffectorOptional=stream_filter)

# ----
# Create base curve
panel_2 = Panel("700")
vector_xyz = VectorXYZ(XComponent=0, YComponent=panel_2, ZComponent=panel_2)  # -> Vector, Length
construct_point_2 = ConstructPoint(XCoordinate=0, YCoordinate=panel_2, ZCoordinate=panel_2)
circle_cnr = CircleCNR(Center=construct_point_2, Normal=vector_xyz.Vector, Radius="300")

# ----
# Move
# point
# around
point = Point(Point(-525.5641775, -1.184737959, 0))

approach_distance = Panel("80")
unit_z = UnitZ(Factor=approach_distance)
vector = Vector(unit_z)

simulation = Slider(0, range=0..1)
value_list = ValueList({"Perpendicular frame": 0, "Horizontal frame": 1, "Frame in Y at point": 2}, selected="Frame in Y at point")

# ---- group: Place
brep = Brep(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)
point_2 = Point(Point(-750.2967115, 187.8299875, 75))

# ---- group: Pickup
brep_2 = Brep(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)
point_3 = Point(Point(-802.9882453, -156.5941134, 50))

# ---- group: Place plane
brep_closest_point = BrepClosestPoint(Point=point_2, Brep=brep)  # -> Point, Normal, Distance
reverse = Reverse(Vector=brep_closest_point.Normal)
unit_y = UnitY(Factor=1)
plane_normal = PlaneNormal(Origin=brep_closest_point.Point, ZAxis=reverse)
align_plane = AlignPlane(Plane=plane_normal, Direction=unit_y)  # -> Plane, Angle

# ---- group: Intermitten waypoint plane
line = Line(StartPoint=point_3, EndPoint=point_2)
unit_z_2 = UnitZ(Factor="500")
curve_middle = CurveMiddle(Curve=line)
move_2 = Move(Geometry=curve_middle, Motion=unit_z_2)  # -> Geometry, Transform
unit_z_3 = UnitZ(Factor="-1")
plane_normal_2 = PlaneNormal(Origin=move_2.Geometry, ZAxis=unit_z_3)

# ---- group: Pickup plane
brep_closest_point_2 = BrepClosestPoint(Point=point_3, Brep=brep_2)  # -> Point, Normal, Distance
reverse_2 = Reverse(Vector=brep_closest_point_2.Normal)
unit_y_2 = UnitY(Factor=1)
plane_normal_3 = PlaneNormal(Origin=brep_closest_point_2.Point, ZAxis=reverse_2)
align_plane_2 = AlignPlane(Plane=plane_normal_3, Direction=unit_y_2)  # -> Plane, Angle

# ---- group: Pickup approach plane
move_3 = Move(Geometry=align_plane_2.Plane, Motion=vector)  # -> Geometry, Transform
plane_2 = Plane(move_3.Geometry)

# ---- group: Placement approach plane
move_4 = Move(Geometry=align_plane.Plane, Motion=vector)  # -> Geometry, Transform
plane_3 = Plane(move_4.Geometry)

# ---- group: Merge plane way point
plane_4 = Plane(plane_normal_2)
plane_5 = Plane(plane_2)
plane_6 = Plane(align_plane_2.Plane)
plane_7 = Plane(plane_2)
plane_8 = Plane(plane_normal_2)
plane_9 = Plane(plane_3)
plane_10 = Plane(align_plane.Plane)
plane_11 = Plane(plane_3)
plane_12 = Plane(plane_normal_2)
merge = Merge(
    Data1=plane_4,
    Data2=plane_5,
    Data3=plane_6,
    Data4=plane_7,
    Data5=plane_8,
    Data6=plane_9,
    Data7=plane_10,
    Data8=plane_11,
    Data9=plane_12)

# ----
# 2: Pick and place
simulation_2 = Slider(0, range=0..1)
number = Number(simulation_2)
interpolate = Interpolate(Vertices=merge, Degree=1, Periodic=False, KnotStyle=1)  # -> Curve, Length, Domain
interpolate_frames = InterpolateFrames(Frames=merge, Length=number, Step="0.01", Reset=Toggle(True))  # -> Frame, Percent, CurrentIndex
plane_13 = Plane(interpolate_frames.Frame)

# ----
# 0: Move to point
xy_plane_2 = XYPlane(Origin=point)
flip_plane = FlipPlane(Plane=xy_plane_2, ReverseX=False, ReverseY=False, SwapAxes=True)
plane_14 = Plane(flip_plane)

# ----
# 1: Follow curve
number_2 = Number(simulation)
curve = Curve(reparameterize(circle_cnr))

evaluate_curve = EvaluateCurve(Curve=curve, Parameter=number_2)  # -> Point, Tangent, Angle
unit_y_3 = UnitY(Factor=1)
plane_normal_4 = PlaneNormal(Origin=evaluate_curve.Point, ZAxis=unit_y_3)
plane_15 = Plane(plane_normal_4)

horizontal_frame = HorizontalFrame(Curve=curve, Parameter=number_2)
plane_16 = Plane(horizontal_frame)

# ----
# Create plane on curve
perp_frame = PerpFrame(Curve=reparameterize(curve), Parameter=number_2)
plane_17 = Plane(perp_frame)

stream_filter_2 = StreamFilter(Gate=value_list, Stream0=plane_17, Stream1=plane_16, Stream2=plane_15)
plane_18 = Plane(stream_filter_2)

# ----
# Pick
# Simulation
# Option
value_list_2 = ValueList({"Move point manually": 0, "Point along curve": 1, "Pick and place": 2}, selected="Move point manually")
stream_filter_3 = StreamFilter(Gate=value_list_2, Stream0=plane_14, Stream1=plane_18, Stream2=plane_13)

preview = StreamFilter(Gate=value_list_2, Stream0=plane_14)

preview_2 = StreamFilter(Gate=value_list_2, Stream1=[curve, evaluate_curve.Point])

preview_3 = StreamFilter(Gate=value_list_2, Stream2=[brep_2, brep, merge, interpolate.Curve])

# ----
# Simulate robot position
plane_19 = Plane(stream_filter_3)
robot_ik = RobotInverseKinematics(Robot=predefined_universal_robot_ur10, TargetTCPFrame=plane_19, AxisToggles=[False, False, False], useColorPreview=True)  # -> PoseGeometry, AxisValues, AxisFrames
